# Grasshopper definition cpig_slop_loader.gh (Grasshopper 1.0.8)
# plug-ins: Slop

# ---- group: Inputs
jsonpath = Panel("C:/Repos/CPig/research/slop_tests/00_smoke_ping.json")
build = BooleanToggle(False)
cleanup = BooleanToggle(False)

# ---- group: Diagnostics
loghub = LogHub(Enable=True, Clear=False)  # -> Status, Recent, Solutions, ActiveFile
crashguard = CrashGuard(Enable=True, Verbose=False)  # -> Status, DumpDir, TraceFile

# ---- group: Builder
# CPig Slop Loader
slop = Slop(Build=build, Files=jsonpath, SmartMulti=False)  # -> Log, Success, Count, Schema

# ---- group: Cleaner
slopx = SlopCleanup(Run=cleanup)  # -> Log, Removed

# ---- group: Reports
sloplog = Panel(slop.Log)
slopsuccess = Panel(slop.Success)
slopcount = Panel(slop.Count)
cleanuplog = Panel(slopx.Log)
cleanupcount = Panel(slopx.Removed)
