# Grasshopper definition lightro_slop_loader.gh (Grasshopper 1.0.8)
# plug-ins: Slop

# ---- group: Diagnostics
crashguard = CrashGuard(Enable=True, Verbose=False)  # -> Status, DumpDir, TraceFile
loghub = LogHub(Enable=True, Clear=False)  # -> Status, Recent, Solutions, ActiveFile

# ---- group: Inputs
jsonpath = Panel("C:/Repos/LytroHopper/tests/slop/01_load_refocus.json")
build = BooleanToggle(False)
cleanup = BooleanToggle(False)

# ---- group: Builder
# LytroHopper Slop Loader
slop = Slop(Build=build, Files=jsonpath, SmartMulti=False, Strict=False)  # -> Log, Success, Count, Schema

# ---- group: Cleaner
slopx = SlopCleanup(Run=cleanup)  # -> Log, Removed

# ---- group: Reports
sloplog = Panel(slop.Log)
slopsuccess = Panel(slop.Success)
slopcount = Panel(slop.Count)
cleanuplog = Panel(slopx.Log)
cleanupcount = Panel(slopx.Removed)
